# Grasshopper definition dragon_curve_v1.gh (Grasshopper 1.0.7)
# Copyright: KAJIMA DESIGN

# STEP 2:GH_Python
number_slider = Slider(0, range=0..1440)
# STEP 1:既存コンポーネント
panel = Panel("0, 0, 0")
line = LineSDL(Start=panel, Direction="1, 0, 0", Length="10")
python = GhPythonScript(degree=number_slider, lineLen=Slider(10, range=0..10))  # -> out, a, b; inputs degree: Int32
# ---------- python: Python ----------
from Rhino.Geometry import *
from math import radians

pts = [Point3d(0, 0, 0), Point3d(lineLen, 0, 0)]
pts = Polyline(pts)

for i in range(0, degree-89, 90):
    cachePts = pts.Duplicate()
    cachePts.Reverse()
    cachePts.RemoveAt(0)
    tr = Transform.Rotation(
        radians(90), 
        Vector3d(0, 0, 1), 
        pts.Last)
    cachePts.Transform(tr)
    pts.AddRange(cachePts)

a = pts.ToNurbsCurve()

if degree%90 != 0:
    cachePts = pts.Duplicate()
    cachePts.Reverse()
    tr = Transform.Rotation(
        radians(degree%90), 
        Vector3d(0, 0, 1), 
        pts.Last)
    cachePts.Transform(tr)
    b = cachePts.ToNurbsCurve()
# ---------- end python ----------

crv = Curve(line)
flip = FlipCurve(Curve=crv)  # -> Curve, Flag
end = EndPoints(Curve=crv)  # -> Start, End
xy = XYPlane(Origin=end.End)
rotate = Rotate(Geometry=flip.Curve, Angle=1.570796327, Plane=xy)  # -> Geometry, Transform
join = JoinCurves(Curves=[crv, rotate.Geometry], Preserve=False)
crv_2 = Curve(join)

crv_3 = Curve(crv_2)
flip_2 = FlipCurve(Curve=crv_3)  # -> Curve, Flag
end_2 = EndPoints(Curve=crv_3)  # -> Start, End
xy_2 = XYPlane(Origin=end_2.End)
rotate_2 = Rotate(Geometry=flip_2.Curve, Angle=1.570796327, Plane=xy_2)  # -> Geometry, Transform
join_2 = JoinCurves(Curves=[crv_3, rotate_2.Geometry], Preserve=False)
crv_4 = Curve(join_2)

crv_5 = Curve(crv_4)
flip_3 = FlipCurve(Curve=crv_5)  # -> Curve, Flag
end_3 = EndPoints(Curve=crv_5)  # -> Start, End
xy_3 = XYPlane(Origin=end_3.End)
rotate_3 = Rotate(Geometry=flip_3.Curve, Angle=1.570796327, Plane=xy_3)  # -> Geometry, Transform
join_3 = JoinCurves(Curves=[crv_5, rotate_3.Geometry], Preserve=False)
crv_6 = Curve(join_3)

crv_7 = Curve(crv_6)
flip_4 = FlipCurve(Curve=crv_7)  # -> Curve, Flag
end_4 = EndPoints(Curve=crv_7)  # -> Start, End
xy_4 = XYPlane(Origin=end_4.End)
rotate_4 = Rotate(Geometry=flip_4.Curve, Angle=1.570796327, Plane=xy_4)  # -> Geometry, Transform
join_4 = JoinCurves(Curves=[crv_7, rotate_4.Geometry], Preserve=False)
crv_8 = Curve(join_4)

crv_9 = Curve(crv_8)
flip_5 = FlipCurve(Curve=crv_9)  # -> Curve, Flag
end_5 = EndPoints(Curve=crv_9)  # -> Start, End
xy_5 = XYPlane(Origin=end_5.End)
rotate_5 = Rotate(Geometry=flip_5.Curve, Angle=1.570796327, Plane=xy_5)  # -> Geometry, Transform
join_5 = JoinCurves(Curves=[crv_9, rotate_5.Geometry], Preserve=False)
crv_10 = Curve(join_5)

number_slider_2 = Slider(0.5, range=0..10)
explode = Explode(Curve=python.a, Recursive=True)  # -> Segments, Vertices
explode_2 = Explode(Curve=python.b, Recursive=True)  # -> Segments, Vertices
python_2 = GhPythonScript(x=explode.Segments, y=number_slider_2)  # -> out, a; inputs x: Line
# ---------- python_2: Python ----------
from Rhino.Geometry import NurbsSurface as NS
from Rhino.Geometry import Vector3d as vec
from Rhino.Geometry import Transform
from Rhino.Geometry import Point3d
from math import pi

direction = x.Direction
direction.Rotate(pi/2, vec(0, 0, 1))
direction.Unitize()

c0 = x.From
c1 = x.From
c2 = x.To
c3 = x.To

trP = Transform.Translation(direction *  y)
trM = Transform.Translation(direction * -y)

c0.Transform(trP)
c1.Transform(trM)
c2.Transform(trM)
c3.Transform(trP)

a = NS.CreateFromCorners(c0, c1, c2, c3)
# ---------- end python_2 ----------
python_3 = GhPythonScript(x=explode_2.Segments, y=number_slider_2)  # -> out, a; inputs x: Line; same code as python_2
preview = CustomPreview(Geometry=python_2.a, Material=ColourSwatch(SwatchColor=RGB(0, 0, 0)))
preview_2 = CustomPreview(Geometry=python_3.a, Material=ColourSwatch(SwatchColor=RGBA(0, 0, 255, 193)))
